% Simulink design studies sineGain.mldatx for model contGain

study "设计研究": 10 simulations
  combinatorial set (10 points):
    "模块参数_1": BlockParameter(BlockPath=contGain/Gain, Name=k), values [1:10] (10 points)